# Grasshopper definition test.gh (Grasshopper 1.0.7)
# plug-ins: Transfinite, LunchBox

panel = Panel("132.191 109.775 3.38065 123.46 116.194 11.2296 108.597 127.461 21.0665 92.0275 137.526 13.0152 83.9708 142.896 8.24165")
panel_2 = Panel("83.9708 142.896 8.24165 56.2923 127.796 9.87244 24.0174 118.532 8.4064 -7.25685 116.377 5.19098")
panel_3 = Panel("0.019329 11.8409 8.48475 13.1342 12.0097 8.47983 51.8205 -2.19188 8.49852 58.3194 -57.8379 8.16055 55.7628 -90.3898 8.64392 53.9182 -100 8.47485")
panel_4 = Panel("100 -100 0 99.065 -68.6247 -0.632911 101.652 -15.9413 -0.711095 115.079 54.0322 1.48612 126.276 92.4937 3.66448 132.191 109.775 3.38065")
panel_5 = Panel("-7.25685 116.377 5.19098 -6.20675 98.9834 18.6448 -4.03982 64.015 31.614 -0.726455 28.2153 16.9218 0.019329 11.8409 8.48475")
panel_6 = Panel("53.9182 -100 8.47485 61.3858 -99.653 11.4727 79.049 -100.186 15.9436 93.0327 -100 7.21678 100 -100 0")
cluster = Cluster(pt=panel, K="0 0 0 0.545052 1 1 1")  # -> pt_3, K_2
cluster_2 = Cluster(pt=panel_2, K="0 0 0 1 1 1")  # -> pt_3, K_2
cluster_3 = Cluster(pt=panel_5, K="0 0 0 0.518535 1 1 1")  # -> pt_3, K_2
cluster_4 = Cluster(pt=panel_3, K="0 0 0 0.270352 0.795435 1 1 1")  # -> pt_3, K_2
cluster_5 = Cluster(pt=panel_6, K="0 0 0 0.482422 1 1 1")  # -> pt_3, K_2
cluster_6 = Cluster(pt=panel_4, K="0 0 0 0.437553 0.74263 1 1 1")  # -> pt_3, K_2
nurbcrv = NurbsCurvePWK(Points=flatten(cluster.pt_3), Knots=cluster.K_2)  # -> Curve, Length, Domain
nurbcrv_2 = NurbsCurvePWK(Points=flatten(cluster_2.pt_3), Knots=cluster_2.K_2)  # -> Curve, Length, Domain
nurbcrv_3 = NurbsCurvePWK(Points=flatten(cluster_3.pt_3), Knots=cluster_3.K_2)  # -> Curve, Length, Domain
nurbcrv_4 = NurbsCurvePWK(Points=flatten(cluster_4.pt_3), Knots=cluster_4.K_2)  # -> Curve, Length, Domain
nurbcrv_5 = NurbsCurvePWK(Points=flatten(cluster_5.pt_3), Knots=cluster_5.K_2)  # -> Curve, Length, Domain
nurbcrv_6 = NurbsCurvePWK(Points=flatten(cluster_6.pt_3), Knots=cluster_6.K_2)  # -> Curve, Length, Domain
shatter = Shatter(Curve=nurbcrv_4.Curve, Parameters="0.5")
flatten = FlattenTree(Tree=shatter, Path="{0;0}")
merge = Merge(
    Data1=nurbcrv.Curve,
    Data2=nurbcrv_2.Curve,
    Data3=nurbcrv_3.Curve,
    Data4=flatten,
    Data5=nurbcrv_5.Curve,
    Data6=nurbcrv_6.Curve)

projected_ribbon_curve_0_001 = Curve([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])

projected_ribbon_curve_0_001_2 = Curve(reparameterize([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]))
offsetted = Curve([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])
sphere = Geometry(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)
curve2 = Curve([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])
crv = Curve(reparameterize(curve2))
crv_2 = Curve(reparameterize(projected_ribbon_curve_0_001_2))

projected_ribbon_curve_0_001_3 = Curve([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])
offsetted_2 = Curve([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])
sphere_3 = Geometry(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)
curve3 = Curve([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])
crv_3 = Curve(reparameterize(curve3))
crv_4 = Curve(reparameterize(projected_ribbon_curve_0_001_3))

curve = Curve([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])
crv_5 = Curve(reparameterize(curve))
crv_6 = Curve(reparameterize(projected_ribbon_curve_0_001))
line = Line(Line((0, 0, 0), (21, 0, 0)))
pt = Point(Point(0, -0.2351908478, 20.63919864))
pi = Pi(Factor=Slider(0.27, range=0..1))

pt_2 = Point(Point(0, 0, 0))
pt_3 = Point(Point(2, 0, 0))
pt_4 = Point(Point(2, 1, 0))
pt_5 = Point(Point(1, 1, 0))
pt_6 = Point(Point(1, 1, 0))
pt_7 = Point(Point(1, 2, 0))
pt_8 = Point(Point(1, 2, 0))
pt_9 = Point(Point(0, 0, 0))
pt_10 = Point(Point(2, 0, 0))
pt_11 = Point(Point(2, 1, 0))
pt_12 = Point(Point(0, 2, 0))
pt_13 = Point(Point(0, 2, 0))
panel_7 = Panel(pt_2)
panel_8 = Panel(pt_10)
panel_9 = Panel(pt_3)
panel_10 = Panel(pt_11)
panel_11 = Panel(pt_4)
panel_12 = Panel(pt_5)
panel_13 = Panel(pt_6)
panel_14 = Panel(pt_7)
panel_15 = Panel(pt_8)
panel_16 = Panel(pt_12)
panel_17 = Panel(pt_13)
panel_18 = Panel(pt_9)
ln = Line(StartPoint=panel_7, EndPoint=panel_8)
ln_2 = Line(StartPoint=panel_9, EndPoint=panel_10)
ln_3 = Line(StartPoint=panel_11, EndPoint=panel_12)
ln_4 = Line(StartPoint=panel_13, EndPoint=panel_14)
ln_5 = Line(StartPoint=panel_15, EndPoint=panel_16)
ln_6 = Line(StartPoint=panel_17, EndPoint=panel_18)
cluster_7 = Cluster_4(C=ln)
cluster_8 = Cluster_4(C=ln_2)
cluster_9 = Cluster_4(C=ln_3)
cluster_10 = Cluster_4(C=ln_4)
cluster_11 = Cluster_4(C=ln_5)
cluster_12 = Cluster_4(C=ln_6)
crv_7 = Curve(cluster_7)
crv_8 = Curve(cluster_8)
crv_9 = Curve(cluster_9)
crv_10 = Curve(cluster_10)
crv_11 = Curve(cluster_11)
crv_12 = Curve(cluster_12)
merge_2 = Merge(Data1=crv_7, Data2=crv_8, Data3=crv_9, Data4=crv_10, Data5=crv_11, Data6=crv_12)  # -> flatten(Result)

move = Move(Geometry=sphere_3, Motion=pt)  # -> Geometry, Transform
rectangle = Rectangle(Plane=PlaneXY(0, 0, 0), XSize=Domain(-1, 1), YSize=Domain(-2, 2), Radius=0)  # -> Rectangle, Length
rotax = RotateAxis(Geometry=move.Geometry, Angle=1.570796327, Axis=Line((0, 0, 0), (10, 0, 0)))  # -> Geometry, Transform
scale = Scale(Geometry=rectangle.Rectangle, Center=Point(0, 0, 0), Factor=100)  # -> Geometry, Transform
panel_19 = Panel(".22")
crv_13 = Curve([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])
flip = FlipCurve(Curve=crv_9)  # -> Curve, Flag
crv_14 = Curve()
list = ValueList({"Salvi Shape": 0, "L Shape (seperate)": 1, "L Shape (merged)": 2, "sero": 3}, selected="sero")
number_slider = Slider(0.81, range=0..1)
number_slider_2 = Slider(0.81, range=0..1)
subtraction = Subtraction(A="1", B=number_slider)
subtraction_2 = Subtraction(A="1", B=number_slider_2)
pt_14 = Point(Point(1, 0, 0.2))
pt_15 = Point(Point(-1, 0, 0.2))
pt_16 = Point(Point(0, -1, 0.2))
pt_17 = Point(Point(0, 1, 0.2))
pt_18 = Point(Point(-1, 0, 0.2))
pt_19 = Point(Point(0, -1, 0.2))
merge_3 = Merge(Data1=pt_17, Data2=pt_15, Data3=pt_16, Data4=pt_18, Data5=pt_19, Data6=pt_14)
list_2 = ValueList({"Harmonic Point": 3, "Radial Distance Function": 4}, selected="Harmonic Point")
number_slider_3 = Slider(1.706, range=0..2)
list_3 = ValueList({"Special Side Blending": 2}, selected="Special Side Blending")
unit = UnitVector(Vector=merge_3)
list_4 = ValueList({"Regular Domain": 0, "Concave Domain": 1}, selected="Concave Domain")
division = Division(A=unit, B=Slider(3, range=0..10))
number_slider_4 = Slider(11036, range=0..30000)

# ---- group: Sphere
brep = Brep(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)
preview = CustomPreview(
    Geometry=brep,
    Material={diffuse=RGB(0, 0, 255), emission=RGB(66, 48, 66), shine=0.5, specular=RGB(255, 255, 255), transparency=0.65})

# ----
panel_20 = Panel("132.191 109.775 3.38065 123.46 116.194 11.2296 108.597 127.461 21.0665 92.0275 137.526 13.0152 83.9708 142.896 8.24165")  # disabled
panel_21 = Panel("83.9708 142.896 8.24165 56.2923 127.796 9.87244 24.0174 118.532 8.4064 -7.25685 116.377 5.19098")  # disabled
panel_22 = Panel("100 -100 0 99.065 -68.6247 -0.632911 101.652 -15.9413 -0.711095 115.079 54.0322 1.48612 126.276 92.4937 3.66448 132.191 109.775 3.38065")  # disabled
panel_23 = Panel("0.019329 11.8409 8.48475 13.1342 12.0097 8.47983 51.8205 -2.19188 8.49852 58.3194 -57.8379 8.16055 55.7628 -90.3898 8.64392 53.9182 -100 8.47485")  # disabled
panel_24 = Panel("-7.25685 116.377 5.19098 -6.20675 98.9834 18.6448 -4.03982 64.015 31.614 -0.726455 28.2153 16.9218 0.019329 11.8409 8.48475")  # disabled
panel_25 = Panel("53.9182 -100 8.47485 61.3858 -99.653 11.4727 79.049 -100.186 15.9436 93.0327 -100 7.21678 100 -100 0")  # disabled
panel_26 = Panel("0 0 0 0.437553 0.74263 1 1 1")  # disabled
panel_27 = Panel("0 0 0 0.270352 0.795435 1 1 1")  # disabled
panel_28 = Panel("0 0 0 0.482422 1 1 1")  # disabled
panel_29 = Panel("0 0 0 0.545052 1 1 1")  # disabled
panel_30 = Panel("0 0 0 1 1 1")  # disabled
panel_31 = Panel("0 0 0 0.518535 1 1 1")  # disabled
cluster_13 = Cluster(pt=panel_20, K=panel_29)  # -> pt_3, K_2; disabled
cluster_14 = Cluster(pt=panel_21, K=panel_30)  # -> pt_3, K_2; disabled
cluster_15 = Cluster(pt=panel_24, K=panel_31)  # -> pt_3, K_2; disabled
cluster_16 = Cluster(pt=panel_23, K=panel_27)  # -> pt_3, K_2; disabled
cluster_17 = Cluster(pt=panel_25, K=panel_28)  # -> pt_3, K_2; disabled
cluster_18 = Cluster(pt=panel_22, K=panel_26)  # -> pt_3, K_2; disabled
nurbcrv_7 = NurbsCurvePWK(Points=flatten(cluster_13.pt_3), Knots=cluster_13.K_2)  # -> Curve, Length, Domain; disabled
nurbcrv_8 = NurbsCurvePWK(Points=flatten(cluster_14.pt_3), Knots=cluster_14.K_2)  # -> Curve, Length, Domain; disabled
nurbcrv_9 = NurbsCurvePWK(Points=flatten(cluster_15.pt_3), Knots=cluster_15.K_2)  # -> Curve, Length, Domain; disabled
nurbcrv_10 = NurbsCurvePWK(Points=flatten(cluster_16.pt_3), Knots=cluster_16.K_2)  # -> Curve, Length, Domain; disabled
nurbcrv_11 = NurbsCurvePWK(Points=flatten(cluster_17.pt_3), Knots=cluster_17.K_2)  # -> Curve, Length, Domain; disabled
nurbcrv_12 = NurbsCurvePWK(Points=flatten(cluster_18.pt_3), Knots=cluster_18.K_2)  # -> Curve, Length, Domain; disabled
panel_32 = Panel("0.5")  # disabled
shatter_2 = Shatter(Curve=nurbcrv_10.Curve, Parameters=panel_32)  # disabled
flatten_2 = FlattenTree(Tree=shatter_2, Path="{0;0}")  # disabled
merge_4 = Merge(
    Data1=nurbcrv_7.Curve,
    Data2=nurbcrv_8.Curve,
    Data3=nurbcrv_9.Curve,
    Data4=nurbcrv_10.Curve,
    Data5=nurbcrv_11.Curve,
    Data6=nurbcrv_12.Curve)  # disabled

panel_33 = Panel("132.191 109.775 3.38065 123.46 116.194 11.2296 108.597 127.461 21.0665 92.0275 137.526 13.0152 83.9708 142.896 8.24165")  # disabled
panel_34 = Panel("83.9708 142.896 8.24165 56.2923 127.796 9.87244 24.0174 118.532 8.4064 -7.25685 116.377 5.19098")  # disabled
panel_35 = Panel("100 -100 0 99.065 -68.6247 -0.632911 101.652 -15.9413 -0.711095 115.079 54.0322 1.48612 126.276 92.4937 3.66448 132.191 109.775 3.38065")  # disabled
panel_36 = Panel("0.019329 11.8409 8.48475 13.1342 12.0097 8.47983 51.8205 -2.19188 8.49852 58.3194 -57.8379 8.16055 55.7628 -90.3898 8.64392 53.9182 -100 8.47485")  # disabled
panel_37 = Panel("-7.25685 116.377 5.19098 -6.20675 98.9834 18.6448 -4.03982 64.015 31.614 -0.726455 28.2153 16.9218 0.019329 11.8409 8.48475")  # disabled
panel_38 = Panel("53.9182 -100 8.47485 61.3858 -99.653 11.4727 79.049 -100.186 15.9436 93.0327 -100 7.21678 100 -100 0")  # disabled
panel_39 = Panel("0 0 0 0.270352 0.795435 1 1 1")  # disabled
panel_40 = Panel("0 0 0 0.482422 1 1 1")  # disabled
panel_41 = Panel("0 0 0 0.437553 0.74263 1 1 1")  # disabled
panel_42 = Panel("0 0 0 0.545052 1 1 1")  # disabled
panel_43 = Panel("0 0 0 1 1 1")  # disabled
panel_44 = Panel("0 0 0 0.518535 1 1 1")  # disabled
cluster_19 = Cluster_3(T=panel_33, K=panel_42)  # -> pt_2, R; disabled
cluster_20 = Cluster_3(T=panel_34, K=panel_43)  # -> pt_2, R; disabled
cluster_21 = Cluster_3(T=panel_37, K=panel_44)  # -> pt_2, R; disabled
cluster_22 = Cluster_3(T=panel_36, K=panel_39)  # -> pt_2, R; disabled
cluster_23 = Cluster_3(T=panel_38, K=panel_40)  # -> pt_2, R; disabled
cluster_24 = Cluster_3(T=panel_35, K=panel_41)  # -> pt_2, R; disabled
nurbcrv_13 = NurbsCurvePWK(Points=flatten(cluster_19.pt_2), Knots=cluster_19.R)  # -> Curve, Length, Domain; disabled
nurbcrv_14 = NurbsCurvePWK(Points=flatten(cluster_20.pt_2), Knots=cluster_20.R)  # -> Curve, Length, Domain; disabled
nurbcrv_15 = NurbsCurvePWK(Points=flatten(cluster_21.pt_2), Knots=cluster_21.R)  # -> Curve, Length, Domain; disabled
nurbcrv_16 = NurbsCurvePWK(Points=flatten(cluster_22.pt_2), Knots=cluster_22.R)  # -> Curve, Length, Domain; disabled
nurbcrv_17 = NurbsCurvePWK(Points=flatten(cluster_23.pt_2), Knots=cluster_23.R)  # -> Curve, Length, Domain; disabled
nurbcrv_18 = NurbsCurvePWK(Points=flatten(cluster_24.pt_2), Knots=cluster_24.R)  # -> Curve, Length, Domain; disabled
panel_45 = Panel("0.5")  # disabled
shatter_3 = Shatter(Curve=nurbcrv_16.Curve, Parameters=panel_45)  # disabled
flatten_3 = FlattenTree(Tree=shatter_3, Path="{0;0}")  # disabled
merge_5 = Merge(
    Data1=nurbcrv_13.Curve,
    Data2=nurbcrv_14.Curve,
    Data3=nurbcrv_15.Curve,
    Data4=flatten_3,
    Data5=nurbcrv_17.Curve,
    Data6=nurbcrv_18.Curve)  # disabled

pt_20 = Point(Point(0, -0.2351908478, 20.63919864))
move_2 = Move(Geometry=sphere_3, Motion=pt_20)  # -> Geometry, Transform
rectangle_2 = Rectangle(Plane=PlaneXY(0, 0, 0), XSize=Domain(-1, 1), YSize=Domain(-2, 2), Radius=0)  # -> Rectangle, Length
rotax_2 = RotateAxis(Geometry=move_2.Geometry, Angle=pi, Axis=line)  # -> Geometry, Transform
scale_2 = Scale(Geometry=rectangle_2.Rectangle, Center=Point(0, 0, 0), Factor=100)  # -> Geometry, Transform
polygon = Polygon(Plane=PlaneXY(0, 0, 0), Radius=Slider(0.6, range=0..3), Segments=6, FilletRadius=0)  # -> Polygon, Length
scale_3 = Scale(Geometry=polygon.Polygon, Center=Point(0, 0, 0), Factor=5)  # -> Geometry, Transform

scale_4 = Scale(Geometry=rotax_2.Geometry, Center=Point(0, 0, 0), Factor=".5")  # -> Geometry, Transform
split = SplitBrep(Brep=scale_4.Geometry, Cutter=scale.Geometry)
item = ListItem(List=split, Index=0, Wrap=True)
explode = Explode(Curve=scale_3.Geometry, Recursive=True)  # -> Segments, Vertices
project = Project(Curve=crv_13, Brep=item, Direction=Vector(0, 0, 1))
crv_15 = Curve(reparameterize(flatten(project)))

pt_21 = Point(Point(0, 0, 0))
pt_22 = Point(Point(2, 0, 0))
pt_23 = Point(Point(2, 1, 0))
pt_24 = Point(Point(1, 1, 0))
pt_25 = Point(Point(1, 2, 0))
pt_26 = Point(Point(1, 2, 0))
pt_27 = Point(Point(0, 0, 0))
pt_28 = Point(Point(2, 0, 0))
pt_29 = Point(Point(2, 1, 0))
pt_30 = Point(Point(1, 1, 0))
pt_31 = Point(Point(0, 2, 0))
pt_32 = Point(Point(0, 2, 0))
panel_46 = Panel(pt_28)
panel_47 = Panel(pt_22)
panel_48 = Panel(pt_29)
panel_49 = Panel(pt_23)
panel_50 = Panel(pt_24)
panel_51 = Panel(pt_30)
panel_52 = Panel(pt_25)
panel_53 = Panel(pt_26)
panel_54 = Panel(pt_31)
panel_55 = Panel(pt_32)
panel_56 = Panel(pt_27)
panel_57 = Panel(pt_21)
ln_7 = Line(StartPoint=panel_57, EndPoint=panel_46)
ln_8 = Line(StartPoint=panel_47, EndPoint=panel_48)
ln_9 = Line(StartPoint=panel_49, EndPoint=panel_50)
ln_10 = Line(StartPoint=panel_51, EndPoint=panel_52)
ln_11 = Line(StartPoint=panel_53, EndPoint=panel_54)
ln_12 = Line(StartPoint=panel_55, EndPoint=panel_56)
cluster_25 = Cluster_4(C=ln_7)
cluster_26 = Cluster_4(C=ln_8)
cluster_27 = Cluster_4(C=ln_9)
cluster_28 = Cluster_4(C=ln_10)
cluster_29 = Cluster_4(C=ln_11)
cluster_30 = Cluster_4(C=ln_12)
crv_16 = Curve(cluster_26)
crv_17 = Curve(cluster_28)
crv_18 = Curve(cluster_29)
crv_19 = Curve(cluster_25)
crv_20 = Curve(cluster_27)
crv_21 = Curve(cluster_30)

join = JoinCurves(Curves=[crv_20, crv_17], Preserve=False)
flatten_4 = FlattenTree(Tree=join, Path="{0}")

merge_6 = Merge(Data1=crv_19, Data2=crv_16, Data3=flatten_4, Data4=crv_18, Data5=crv_21)

split_2 = SplitBrep(Brep=scale_4.Geometry, Cutter=scale_2.Geometry)
item_2 = ListItem(List=split_2, Index=0, Wrap=True)
project_2 = Project(Curve=explode.Segments, Brep=item_2, Direction=Vector(0, 0, 1))
divide = DivideCurve(Curve=project_2, Count=Slider(6, range=0..10), Kinks=False)  # -> Points, Tangents, Parameters
shatter_4 = Shatter(Curve=project_2, Parameters=divide.Parameters)

flatten_5 = FlattenTree(Tree=project_2, Path="{0}")

crv_22 = Curve(flatten_5)

crv_23 = Curve(reparameterize(crv_22))
item_3 = ListItem(List=crv_23, Index=0, Wrap=True)  # -> Item, Item1, Item2, Item3, Item4, Item5
item_4 = ListItem(List=crv_23, Index=0, Wrap=True)  # -> Item, Item1, Item2, Item3, Item4, Item5
crv_24 = Curve(item_3.Item3)
crv_25 = Curve(item_4.Item3)
crv_26 = Curve(item_3.Item)
crv_27 = Curve(item_4.Item)
filter = StreamFilter(Gate=list, Stream0=merge, Stream1=merge_2, Stream2=merge_6, Stream3=crv_23)
eval = EvaluateCurve(Curve=item_3.Item4, Parameter=subtraction)  # -> Point, Tangent, Angle
eval_2 = EvaluateCurve(Curve=item_4.Item3, Parameter=subtraction_2)  # -> Point, Tangent, Angle
eval_3 = EvaluateCurve(Curve=item_3.Item1, Parameter=number_slider)  # -> Point, Tangent, Angle
eval_4 = EvaluateCurve(Curve=item_4.Item, Parameter=number_slider_2)  # -> Point, Tangent, Angle
project_3 = Project(Geometry=filter, Plane=PlaneXY(0, 0, 0))  # -> Geometry, Transform

number_slider_5 = Slider(500, range=0..1000)
patch = PatchSurface(EdgeCurves=project_3.Geometry, U=2, V=2, Tolerance=0.001)
qrsettings = QuadRemeshSettings(
    TargetCount=Slider(10000, range=0..10000),
    AdaptiveSize=0,
    AdaptiveCount=False,
    HardEdges=invert(False),
    SeamEdges=0,
    Symmetry=0,
    GuideCurves=0)
qrmesh = QuadRemesh(Mesh=patch, Settings=qrsettings)

crv_28 = Curve(filter)
midpt = CurveMiddle(Curve=crv_28)
srf_cp = SurfaceClosestPoint(Point=eval_3.Point, Surface=item_2)  # -> Point, UVPoint, Distance
srf_cp_2 = SurfaceClosestPoint(Point=eval_4.Point, Surface=item_2)  # -> Point, UVPoint, Distance
srf_cp_3 = SurfaceClosestPoint(Point=eval.Point, Surface=item_2)  # -> Point, UVPoint, Distance
srf_cp_4 = SurfaceClosestPoint(Point=eval_2.Point, Surface=item_2)  # -> Point, UVPoint, Distance
ln_13 = Line(StartPoint=eval_3.Point, EndPoint=eval.Point)
ln_14 = Line(StartPoint=eval_4.Point, EndPoint=eval_2.Point)
end = EndPoints(Curve=filter)  # -> Start, End
evalsrf = EvaluateSurface(Surface=item_2, Point=srf_cp.UVPoint)  # -> Point, Normal, UDirection, VDirection, Frame
evalsrf_2 = EvaluateSurface(Surface=item_2, Point=srf_cp_3.UVPoint)  # -> Point, Normal, UDirection, VDirection, Frame
xprod = CrossProduct(VectorA=evalsrf.Normal, VectorB=eval_3.Tangent, Unitize=False)  # -> Vector, Length
points = PointList(Points=midpt, Size=Slider(0.3, range=0..1))
cluster_31 = Cluster_2(C=filter)  # -> O, R
vdis = VectorDisplay(Anchor=eval_3.Point, Vector=xprod.Vector)
xprod_2 = CrossProduct(VectorA=evalsrf_2.Normal, VectorB=eval.Tangent, Unitize=False)  # -> Vector, Length
medges = MeshEdges(Mesh=qrmesh)  # -> NakedEdges, InteriorEdges, NonManifoldEdges
vdis_2 = VectorDisplay(Anchor=eval.Point, Vector=xprod_2.Vector)
transfinite = TransfiniteSurface(
    Curves=reparameterize(filter),
    DomainType=list_4,
    Parametrization=list_2,
    Blending=list_3,
    Mesh=qrmesh,
    Sphere=scale_4.Geometry)  # -> Model, DomainC, DomainV, DomainMesh, RibbonVector, RibbonCenter, RibbonVector_2
neg = Negative(Value=cluster_31.R)
extr = Extrude(Base=crv_28, Direction=division)
vdis_3 = VectorDisplay(Anchor=cluster_31.O, Vector=neg)
multiplication = Multiplication(A=xprod.Vector, B=number_slider_3)
preview_2 = CustomPreview(Geometry=extr, Material=ColourSwatch(SwatchColor=RGB(2, 101, 250)))  # disabled
multiplication_2 = Multiplication(A=xprod_2.Vector, B=number_slider_3)

demesh = DeconstructMesh(Mesh=transfinite.Model)  # -> Vertices, Faces, Colours, Normals
conmesh = ConstructMesh(Vertices=demesh.Vertices, Faces=demesh.Faces)
preview_3 = CustomPreview(Geometry=conmesh, Material=ColourSwatch(SwatchColor=RGB(0, 255, 0)))
medges_2 = MeshEdges(Mesh=conmesh)  # -> NakedEdges, InteriorEdges, NonManifoldEdges

medges_3 = MeshEdges(Mesh=transfinite.DomainMesh)  # -> NakedEdges, InteriorEdges, NonManifoldEdges
bzspan = BezierSpan(StartPoint=srf_cp.Point, StartTangent=multiplication, EndPoint=srf_cp_3.Point, EndTangent=multiplication_2)  # -> Curve, Length, Domain
item_5 = ListItem(List=transfinite.DomainV, Index=expr("x*7", number_slider_4), Wrap=True)  # -> Item, Item1, Item2, Item3, Item4, Item5, Item6

# ---- group: uv
item_6 = ListItem(List=transfinite.DomainC, Index=number_slider_4, Wrap=True)

# ---- group: 6 hermit set
item_7 = ListItem(List=transfinite.RibbonVector_2, Index=expr("x*6", number_slider_4), Wrap=True)  # -> Item, Item1, Item2, Item3, Item4, Item5

# ----
merge_7 = Merge(Data1=item_5.Item, Data2=item_5.Item1, Data3=item_5.Item2, Data4=item_5.Item3, Data5=item_5.Item4, Data6=item_5.Item5)

multiplication_3 = Multiplication(A=transfinite.RibbonVector, B=1)
vdis_4 = VectorDisplay(Anchor=transfinite.RibbonCenter, Vector=multiplication_3)
addition = Addition(A=transfinite.RibbonCenter, B=multiplication_3)
partition = PartitionList(List=transfinite.RibbonCenter, Size=50)
partition_2 = PartitionList(List=addition, Size=50)
knob = ControlKnob(Decimals=0, Limit=True, Maximum=100, Minimum=0, Range=100, Value=0)
intcrv = Interpolate(Vertices=partition, Degree=3, Periodic=False, KnotStyle=1)  # -> Curve, Length, Domain
intcrv_2 = Interpolate(Vertices=partition_2, Degree=3, Periodic=False, KnotStyle=1)  # -> Curve, Length, Domain
item_8 = ListItem(List=partition_2, Index=knob, Wrap=True)
rulesrf = RuledSurface(CurveA=intcrv.Curve, CurveB=intcrv_2.Curve)

pt_33 = Point(item_5.Item6)
merge_8 = Merge(Data1=item_7.Item, Data2=item_7.Item1, Data3=item_7.Item2, Data4=item_7.Item3, Data5=item_7.Item4, Data6=item_7.Item5)
cluster_32 = Cluster_6(G=item_6, F=Slider(0.1, range=0..1))
dots = DotDisplay(Point=pt_33, Colour=ColourSwatch(SwatchColor=RGB(0, 162, 255)), Size=Slider(0.045, range=0..1))
preview_4 = CustomPreview(Geometry=merge_8, Material=ColourSwatch(SwatchColor=RGB(255, 251, 0)))
dots_2 = DotDisplay(Point=merge_7, Colour=ColourSwatch(SwatchColor=RGB(0, 0, 0)), Size=Slider(0.045, range=0..1))
cluster_33 = Cluster_5(G=merge_7, F=Slider(0.2, range=0..1))
tag = TextTag(Location=cluster_32, Text="(u,v)")
pline = PolyLine(Vertices=[merge_7, item_5.Item], Closed=False)
points_2 = PointList(Points=cluster_33, Size=Slider(0.3, range=0..1))
preview_5 = CustomPreview(Geometry=pline, Material=ColourSwatch(SwatchColor=RGB(0, 85, 255)))

nickname = RibbonTest(Curves=filter)  # -> M, M2, Rc, Rv; disabled
pt_34 = Point(nickname.Rc)
medges_4 = MeshEdges(Mesh=nickname.M)  # -> NakedEdges, InteriorEdges, NonManifoldEdges
swatch = ColourSwatch(SwatchColor=RGB(255, 31, 31))
demesh_2 = DeconstructMesh(Mesh=nickname.M)  # -> Vertices, Faces, Colours, Normals
demesh_3 = DeconstructMesh(Mesh=nickname.M2)  # -> Vertices, Faces, Colours, Normals
conmesh_2 = ConstructMesh(Vertices=demesh_3.Vertices, Faces=demesh_3.Faces)
conmesh_3 = ConstructMesh(Vertices=demesh_2.Vertices, Faces=demesh_2.Faces, Colours=ColourSwatch(SwatchColor=RGB(2, 101, 250)))

division_2 = Division(A=nickname.Rv, B=5)

vdis_5 = VectorDisplay(Anchor=pt_34, Vector=division_2)

# ==== cluster Cluster
K = ClusterInput()  # K
pt = ClusterInput()  # Pt
split = TextSplit(Text=pt, Separators=" ")
split_2 = TextSplit(Text=K, Separators=" ")
partition = PartitionList(List=split, Size=3)
item = ListItem(List=partition, Index=0, Wrap=True)  # -> Item, Item1, Item2
pt_2 = ConstructPoint(XCoordinate=item.Item, YCoordinate=item.Item1, ZCoordinate=item.Item2)
K_2 = ClusterOutput(split_2)  # K
pt_3 = ClusterOutput(pt_2)  # Pt

# ==== cluster Cluster_2
C = ClusterInput()
range = Range(Domain=Domain(0, 1), Steps=Slider(20, range=0..100))
hframe = HorizontalFrame()
cdiv = Derivatives(Curve=reparameterize(graft(C)), Parameter=range)  # -> Point, FirstDerivative
pframe = PerpFrame(Curve=reparameterize(graft(C)), Parameter=range)
pl = PlaneNormal(Origin=cdiv.Point, ZAxis=cdiv.FirstDerivative)
deplane = DeconstructPlane(Plane=pframe)  # -> Origin, XAxis, YAxis, ZAxis
multiplication = Multiplication(A=deplane.XAxis, B=Slider(50, range=0..100))
vdis = VectorDisplay(Anchor=deplane.Origin, Vector=multiplication)
R = ClusterOutput(multiplication)
O = ClusterOutput(deplane.Origin)

# ==== cluster Cluster_3
T = ClusterInput()
K = ClusterInput()  # K
split = TextSplit(Text=T, Separators=" ")
split_2 = TextSplit(Text=K, Separators=" ")
partition = PartitionList(List=split, Size=3)
R = ClusterOutput(split_2)
item = ListItem(List=partition, Index=0, Wrap=True)  # -> Item, Item1, Item2
pt = ConstructPoint(XCoordinate=item.Item, YCoordinate=item.Item1, ZCoordinate=Slider(0, range=0..100))
pt_2 = ClusterOutput(pt)

# ==== cluster Cluster_4
C = ClusterInput()
reb = RebuildCurve(Curve=C, Degree=Slider(3, range=0..10), Count=Slider(4, range=0..10), Tangents=False)
C_2 = ClusterOutput(reb)

# ==== cluster Cluster_5
G = ClusterInput()
F = ClusterInput()
X = UnitX(Factor=F)
move = Move(Geometry=G, Motion=X)  # -> Geometry, Transform
G_2 = ClusterOutput(move.Geometry)

# ==== cluster Cluster_6
F = ClusterInput()
G = ClusterInput()
X = UnitX(Factor=F)
move = Move(Geometry=G, Motion=X)  # -> Geometry, Transform
G_2 = ClusterOutput(move.Geometry)
